# Grasshopper definition script_final.gh (Grasshopper 0.9.76)
# plug-ins: Python Interpreter, Kangaroo Components

pointslider = Slider(3107, range=0..10000)
python_script = PythonScript()  # -> out, a, b
# ---------- python_script: Python ----------
a=0
while a<10:
    b=0
    a+=1
    b=1
# ---------- end python_script ----------
timer = Timer(TimerInterval=100, Target=[python_script_2, python_script_3])  # disabled
recorrido = Curve(<curve referenced from the Rhino model>)
flip_curve = FlipCurve(Curve=recorrido)  # -> Curve, Flag
python_script_2 = PythonScript()
# ---------- python_script_2: Python ----------
import Grasshopper as gh
from collections import deque

#  Number of demos
demos = 10001


if "carussal" not in globals():
    carussal = deque(range(demos))
print carussal
carussal.rotate(-1)
for obj in ghenv.Component.OnPingDocument().Objects:
    if obj.NickName == "pointslider":
        if type(obj) is gh.Kernel.Special.GH_NumberSlider:
            obj.Slider.Value = carussal[0]
            obj.ExpireSolution(True)
# ---------- end python_script_2 ----------
division = Division(A=pointslider, B="10000")
python_script_3 = PythonScript()  # -> out, a; same code as python_script_2
evaluate_curve = EvaluateCurve(Curve=reparameterize(flip_curve.Curve), Parameter=division)  # -> Point, Tangent, Angle
pointcurve = Point(evaluate_curve.Point)
vtangente = Vector(evaluate_curve.Tangent)
msphereex = MeshSphereEx(Base=pointcurve, Radius=10, Count=Slider(40, range=0..100))
edificio = Mesh([<mesh referenced from the Rhino model> x361])
clean = CombineClean(Meshes=msphereex)
mjoin = MeshJoin(Meshes=edificio)
demesh = DeconstructMesh(Mesh=clean)  # -> Vertices, Faces, Colours, Normals
vector_2pt = Vector2Pt(PointA=demesh.Vertices, PointB=pointcurve, Unitize=Toggle(False))  # -> Vector, Length

# ---- group: NOMBRE DEL ARCHIVO
integer = Integer(pointslider)
numarchivo = PythonScript(x=integer)  # -> out, a
# ---------- numarchivo: Python ----------
b=len(str(x))
a=str(x)
if b==1: a='000'+a
if b==2: a='00'+a
if b==3: a='0'+a
# ---------- end numarchivo ----------
nombrearchivo = PythonScript()  # -> a
# ---------- nombrearchivo: Python ----------
a = ghenv.LocalScope.ghdoc.Path
n=a.rfind("\\")+1
a=a[n:-3]
# ---------- end nombrearchivo ----------
concatenate = Concatenate(FragmentA="\\Mac\Home\Documents\AI\00_Proyecto\csv\", FragmentB=nombrearchivo)
concatenate_2 = Concatenate(FragmentA=concatenate, FragmentB=numarchivo.a)

# ----
meshray = MeshRay(Mesh=mjoin, Point=pointcurve, Direction=graft(vector_2pt.Vector))  # -> Point, Hit

# ---- group: ESTOS VECTORES SON LOS QUE SIEMPRE SE USARAN PARA CALCULAR LA POSICION DE CADA PUNTO
vector_display = VectorDisplay(Anchor=pointcurve, Vector=vector_2pt.Vector)
panel = Panel(vector_2pt.Vector)
c_script = CSharpScript(Path="\\Mac\Home\Documents\AI\00_Proyecto\csv\direcciones", DataSet=vector_2pt.Vector, Run=Toggle(True))  # -> out, A; inputs Path: String, DataSet: tree, Run: Boolean
# ---------- c_script: C# ----------
    if (Run)
    {
      List<List<string>> MyData = new List<List<string>>();

      for (int i = 0; i < DataSet.Branches.Count; i++)
      {
        List<string> tempList = new List<string>();

        foreach (var item in DataSet.Branches[i])
        {
          tempList.Add(item.ToString());
        }
        MyData.Add(tempList);
      }

      if (MyData != null && MyData.Count > 0 && Path != String.Empty)
      {
        using (var writer = new CsvFileWriter(Path + ".csv"))
        {
          // Write each row of data
          foreach (var myList in MyData)
          {
            writer.WriteRow(myList);
          }
        }
      }
    }
# ---------- c_script: C# additional code ----------
  /// <summary>
  /// Determines how empty lines are interpreted when reading CSV files.
  /// These values do not affect empty lines that occur within quoted fields
  /// or empty lines that appear at the end of the input file.
  /// </summary>
  public enum EmptyLineBehavior
  {
    /// <summary>
    /// Empty lines are interpreted as a line with zero columns.
    /// </summary>
    NoColumns,
    /// <summary>
    /// Empty lines are interpreted as a line with a single empty column.
    /// </summary>
    EmptyColumn,
    /// <summary>
    /// Empty lines are skipped over as though they did not exist.
    /// </summary>
    Ignore,
    /// <summary>
    /// An empty line is interpreted as the end of the input file.
    /// </summary>
    EndOfFile,
  }

  /// <summary>
  /// Common base class for CSV reader and writer classes.
  /// </summary>
  public abstract class CsvFileCommon
  {
    /// <summary>
    /// These are special characters in CSV files. If a column contains any
    /// of these characters, the entire column is wrapped in double quotes.
    /// </summary>
    protected char[] SpecialChars = new char[] { ',', '"', '\r', '\n' };

    // Indexes into SpecialChars for characters with specific meaning
    private const int DelimiterIndex = 0;
    private const int QuoteIndex = 1;

    /// <summary>
    /// Gets/sets the character used for column delimiters.
    /// </summary>
    public char Delimiter
    {
      get { return SpecialChars[DelimiterIndex]; }
      set { SpecialChars[DelimiterIndex] = value; }
    }

    /// <summary>
    /// Gets/sets the character used for column quotes.
    /// </summary>
    public char Quote
    {
      get { return SpecialChars[QuoteIndex]; }
      set { SpecialChars[QuoteIndex] = value; }
    }
  }

  /// <summary>
  /// Class for writing to comma-separated-value (CSV) files.
  /// </summary>
  public class CsvFileWriter : CsvFileCommon, IDisposable
  {
    // Private members
    private StreamWriter Writer;
    private string OneQuote = null;
    private string TwoQuotes = null;
    private string QuotedFormat = null;

    /// <summary>
    /// Initializes a new instance of the CsvFileWriter class for the
    /// specified stream.
    /// </summary>
    /// <param name="stream">The stream to write to</param>
    public CsvFileWriter(Stream stream)
    {
      Writer = new StreamWriter(stream);
    }

    /// <summary>
    /// Initializes a new instance of the CsvFileWriter class for the
    /// specified file path.
    /// </summary>
    /// <param name="path">The name of the CSV file to write to</param>
    public CsvFileWriter(string path)
    {
      Writer = new StreamWriter(path);
    }

    /// <summary>
    /// Writes a row of columns to the current CSV file.
    /// </summary>
    /// <param name="columns">The list of columns to write</param>
    public void WriteRow(List<string> columns)
    {
      // Verify required argument
      if (columns == null)
        throw new ArgumentNullException("columns");

      // Ensure we're using current quote character
      if (OneQuote == null || OneQuote[0] != Quote)
      {
        OneQuote = String.Format("{0}", Quote);
        TwoQuotes = String.Format("{0}{0}", Quote);
        QuotedFormat = String.Format("{0}{{0}}{0}", Quote);
      }

      // Write each column
      for (int i = 0; i < columns.Count; i++)
      {
        // Add delimiter if this isn't the first column
        if (i > 0)
          Writer.Write(Delimiter);
        // Write this column
        if (columns[i].IndexOfAny(SpecialChars) == -1)
          Writer.Write(columns[i]);
        else
          Writer.Write(QuotedFormat, columns[i].Replace(OneQuote, TwoQuotes));
      }
      Writer.WriteLine();
    }

    // Propagate Dispose to StreamWriter
    public void Dispose()
    {
      Writer.Dispose();
    }
  }
# ---------- end c_script ----------

# ----
panel_2 = Panel(meshray.Point)

# ---- group: sacamos distancias y escribimos dataset
vector_2pt_2 = Vector2Pt(PointA=meshray.Point, PointB=pointcurve, Unitize=False)  # -> Vector, Length
null_item = NullItem(Item=vector_2pt_2.Length)  # -> NullFlags, InvalidFlags, Description
cull_pattern = CullPattern(List=vector_2pt_2.Length, CullPattern=null_item.NullFlags)
replace_items = ReplaceItems(List=vector_2pt_2.Length, Item=Slider(0, range=0..100), Indices=cull_pattern, Wrap=False)  # -> flatten(List)
panel_3 = Panel("1")

# ----
entwine = Entwine(Branch00=pointcurve, Branch01=vtangente, Branch02=replace_items, FlattenInputs=True)  # -> flatten(Result)

# ---- group: sacamos distancias y escribimos dataset (continued)
c_script_2 = CSharpScript(Path=concatenate_2, DataSet=entwine, Run=python_script.b)  # -> out, A; inputs Path: String, DataSet: tree, Run: Boolean; same code as c_script

# ----
graft_tree = GraftTree(Tree=entwine, IncludeEmptyLists=True, IncludeNullItems=True)  # -> simplify(Tree)
panel_4 = Panel(graft_tree)
