# Grasshopper definition script_final_paralelos.gh (Grasshopper 0.9.76)
# plug-ins: Python Interpreter, TT Toolbox

# ---- group: vectores
vector = Vector([Vector(-0.1627988944, 0, -0.9866592725), Vector(-0.2602480538, 0, -0.9655417912), Vector(-0.353656139, 0, -0.935375505), Vector(-0.441735842, 0, -0.8971451643), Vector(-0.52344722, 0, -0.8520581013), Vector(-0.598030932, 0, -0.8014730216)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])
vector_2 = Vector([Vector(-0.1273429104, 0, -0.9918587516), Vector(-0.221297508, 0, -0.9752063438), Vector(-0.3119549587, 0, -0.9500968918), Vector(-0.3981462035, 0, -0.9173219722), Vector(-0.47889812, 0, -0.8778704863), Vector(-0.5534642406, 0, -0.8328729401)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])

# ----
pointslider = Slider(255, range=0..1000)

# ---- group: EDIFICIO
edificio = Mesh([<mesh referenced from the Rhino model> x361])

# ---- group: CURVA
recorrido = Curve(<curve referenced from the Rhino model>)

# ----
curve = Curve(<curve referenced from the Rhino model>)
timer = Timer(TimerInterval=20, Target=[python_script_2, python_script])  # disabled
el_numero_de_divisiones_del_camino = Panel("1000")
python_script = PythonScript()  # -> out, a
# ---------- python_script: Python ----------
import Grasshopper as gh
from collections import deque

#  Number of demos
demos = 1001


if "carussal" not in globals():
    carussal = deque(range(demos))
print carussal
carussal.rotate(-1)
for obj in ghenv.Component.OnPingDocument().Objects:
    if obj.NickName == "pointslider":
        if type(obj) is gh.Kernel.Special.GH_NumberSlider:
            obj.Slider.Value = carussal[0]
            obj.ExpireSolution(True)
# ---------- end python_script ----------
flip_curve = FlipCurve(Curve=recorrido)  # -> Curve, Flag
division = Division(A=pointslider, B=el_numero_de_divisiones_del_camino)
python_script_2 = PythonScript()  # -> out, a
# ---------- python_script_2: Python ----------
import Grasshopper as gh
from collections import deque

#  Number of demos
demos = 10001


if "carussal" not in globals():
    carussal = deque(range(demos))
print carussal
carussal.rotate(-1)
for obj in ghenv.Component.OnPingDocument().Objects:
    if obj.NickName == "pointslider":
        if type(obj) is gh.Kernel.Special.GH_NumberSlider:
            obj.Slider.Value = carussal[0]
            obj.ExpireSolution(True)
# ---------- end python_script_2 ----------
evaluate_curve = EvaluateCurve(Curve=reparameterize(flip_curve.Curve), Parameter=division)  # -> Point, Tangent, Angle
directores_13600 = Vector([Vector(-0.09555394304, 0, -0.9954242533), Vector(-0.1590620792, 0, -0.987268583), Vector(-0.2215243393, 0, -0.9751548426), Vector(-0.2825513575, 0, -0.9592521725), Vector(-0.3417827498, 0, -0.939778991), Vector(-0.3988936196, 0, -0.9169972084)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])
vtangente = Vector(evaluate_curve.Tangent)
vector1260 = Vector([Vector(-0.2653125392, 0, -0.9641624638), Vector(-0.4735232805, 0, -0.8807813025), Vector(-0.6432989352, 0, -0.7656150991), Vector(-0.7707713648, 0, -0.6371118452), Vector(-0.8595521462, 0, -0.5110480485), Vector(-0.9175205734, 0, -0.3976883169)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])
pointcurve = Point(evaluate_curve.Point)
mjoin = MeshJoin(Meshes=edificio)
meshray = MeshRay(Mesh=mjoin, Point=pointcurve, Direction=vector1260)  # -> Point, Hit
cambiar_nombre_de_edificio = Panel("savoye")

# ---- group: NOMBRE DEL ARCHIVO
integer = Integer(pointslider)
numarchivo = PythonScript(x=integer)  # -> out, a
# ---------- numarchivo: Python ----------
b=len(str(x))
a=str(x)
if b==1: a='000'+a
if b==2: a='00'+a
if b==3: a='0'+a
# ---------- end numarchivo ----------
concatenate = Concatenate(FragmentA="\\Mac\Home\Documents\AI\repo\dataset\1260\", FragmentB=cambiar_nombre_de_edificio)
concatenate_2 = Concatenate(FragmentA=concatenate, FragmentB=numarchivo.a)

# ---- group: VECTORES 1260
c_script = CSharpScript(Path="\\Mac\Home\Documents\AI\repo\dataset\direcciones1260", DataSet=flatten(vector1260), Run=Toggle(False))  # -> out, A; inputs Path: String, DataSet: tree, Run: Boolean
# ---------- c_script: C# ----------
    if (Run)
    {
      List<List<string>> MyData = new List<List<string>>();

      for (int i = 0; i < DataSet.Branches.Count; i++)
      {
        List<string> tempList = new List<string>();

        foreach (var item in DataSet.Branches[i])
        {
          tempList.Add(item.ToString());
        }
        MyData.Add(tempList);
      }

      if (MyData != null && MyData.Count > 0 && Path != String.Empty)
      {
        using (var writer = new CsvFileWriter(Path + ".csv"))
        {
          // Write each row of data
          foreach (var myList in MyData)
          {
            writer.WriteRow(myList);
          }
        }
      }
    }
# ---------- c_script: C# additional code ----------
  /// <summary>
  /// Determines how empty lines are interpreted when reading CSV files.
  /// These values do not affect empty lines that occur within quoted fields
  /// or empty lines that appear at the end of the input file.
  /// </summary>
  public enum EmptyLineBehavior
  {
    /// <summary>
    /// Empty lines are interpreted as a line with zero columns.
    /// </summary>
    NoColumns,
    /// <summary>
    /// Empty lines are interpreted as a line with a single empty column.
    /// </summary>
    EmptyColumn,
    /// <summary>
    /// Empty lines are skipped over as though they did not exist.
    /// </summary>
    Ignore,
    /// <summary>
    /// An empty line is interpreted as the end of the input file.
    /// </summary>
    EndOfFile,
  }

  /// <summary>
  /// Common base class for CSV reader and writer classes.
  /// </summary>
  public abstract class CsvFileCommon
  {
    /// <summary>
    /// These are special characters in CSV files. If a column contains any
    /// of these characters, the entire column is wrapped in double quotes.
    /// </summary>
    protected char[] SpecialChars = new char[] { ',', '"', '\r', '\n' };

    // Indexes into SpecialChars for characters with specific meaning
    private const int DelimiterIndex = 0;
    private const int QuoteIndex = 1;

    /// <summary>
    /// Gets/sets the character used for column delimiters.
    /// </summary>
    public char Delimiter
    {
      get { return SpecialChars[DelimiterIndex]; }
      set { SpecialChars[DelimiterIndex] = value; }
    }

    /// <summary>
    /// Gets/sets the character used for column quotes.
    /// </summary>
    public char Quote
    {
      get { return SpecialChars[QuoteIndex]; }
      set { SpecialChars[QuoteIndex] = value; }
    }
  }

  /// <summary>
  /// Class for writing to comma-separated-value (CSV) files.
  /// </summary>
  public class CsvFileWriter : CsvFileCommon, IDisposable
  {
    // Private members
    private StreamWriter Writer;
    private string OneQuote = null;
    private string TwoQuotes = null;
    private string QuotedFormat = null;

    /// <summary>
    /// Initializes a new instance of the CsvFileWriter class for the
    /// specified stream.
    /// </summary>
    /// <param name="stream">The stream to write to</param>
    public CsvFileWriter(Stream stream)
    {
      Writer = new StreamWriter(stream);
    }

    /// <summary>
    /// Initializes a new instance of the CsvFileWriter class for the
    /// specified file path.
    /// </summary>
    /// <param name="path">The name of the CSV file to write to</param>
    public CsvFileWriter(string path)
    {
      Writer = new StreamWriter(path);
    }

    /// <summary>
    /// Writes a row of columns to the current CSV file.
    /// </summary>
    /// <param name="columns">The list of columns to write</param>
    public void WriteRow(List<string> columns)
    {
      // Verify required argument
      if (columns == null)
        throw new ArgumentNullException("columns");

      // Ensure we're using current quote character
      if (OneQuote == null || OneQuote[0] != Quote)
      {
        OneQuote = String.Format("{0}", Quote);
        TwoQuotes = String.Format("{0}{0}", Quote);
        QuotedFormat = String.Format("{0}{{0}}{0}", Quote);
      }

      // Write each column
      for (int i = 0; i < columns.Count; i++)
      {
        // Add delimiter if this isn't the first column
        if (i > 0)
          Writer.Write(Delimiter);
        // Write this column
        if (columns[i].IndexOfAny(SpecialChars) == -1)
          Writer.Write(columns[i]);
        else
          Writer.Write(QuotedFormat, columns[i].Replace(OneQuote, TwoQuotes));
      }
      Writer.WriteLine();
    }

    // Propagate Dispose to StreamWriter
    public void Dispose()
    {
      Writer.Dispose();
    }
  }
# ---------- end c_script ----------

# ---- group: ESTOS VECTORES SON LOS QUE SIEMPRE SE USARAN PARA CALCULAR LA POSICION DE CADA PUNTO
c_script_2 = CSharpScript(Path="\\Mac\Home\Documents\AI\repo\dataset\direcciones13600", DataSet=flatten(directores_13600), Run=Toggle(False))  # -> out, A; inputs Path: String, DataSet: tree, Run: Boolean; same code as c_script

# ----
panel = Panel(meshray.Point)

# ---- group: GRUPO NO USAR PARA SACAR VISUALES
pi = Pi(Factor=Slider(0.49, range=0..1))
negative = Negative(Value=pi)
range = Range(Domain="0 to 1", Steps=Slider(20, range=0..100))
construct_domain = ConstructDomain(DomainStart=negative, DomainEnd=pi)
xz_plane = XZPlane(Origin=Point(0, 0, 0))
graph = GraphMapper(
    flatten(range),
    x0=0,
    x1=1,
    y0=0,
    y1=1,
    container_name="Sine",
    Equation_px=[0, 0.5009031296],
    Equation_py=[1, 0.276841104])
arc = Arc(Plane=xz_plane, Radius=1, Angle=construct_domain)  # -> Arc, Length
ma = MassAddition(Input=graph)  # -> Result, PartialResults
bnd = Bounds(Numbers=ma.PartialResults)
dom = ConstructDomain(DomainStart=arc.Length, DomainEnd="0")
remap = RemapNumbers(Value=ma.PartialResults, Source=bnd, Target=dom)  # -> Mapped, Clipped
number_slider = Slider(6, range=0..10)
eval = EvaluateLength(Curve=arc.Arc, Length=remap.Mapped, Normalized="false")  # -> Point, Tangent, Parameter

# ----
division_2 = Division(A="360", B=number_slider)

# ---- group: GRUPO NO USAR PARA SACAR VISUALES (continued)
series = Series(Start=0, Step=number_slider, Count=division_2)
radians = Radians(Degrees=series)  # -> graft(Radians)
rotate = Rotate(Geometry=eval.Point, Angle=radians, Plane=PlaneXY(0, 0, 0))  # -> flatten(Geometry), Transform
remove_duplicate_points = RemoveDuplicatePoints(InputPoints=rotate.Geometry, Tolerance=0.001)  # -> OutputPoints, FirstPointIndexes
cull_index = CullIndex(List=rotate.Geometry, Indices=remove_duplicate_points.FirstPointIndexes, Wrap=True)
vector_2pt = Vector2Pt(PointA=cull_index, PointB="0,0,0", Unitize=Toggle(True))  # -> Vector, Length

# ---- group: sacamos distancias y escribimos dataset
vector_2pt_2 = Vector2Pt(PointA=meshray.Point, PointB=pointcurve, Unitize=False)  # -> Vector, graft(Length)
null_item = NullItem(Item=vector_2pt_2.Length)  # -> NullFlags, InvalidFlags, Description
cull_pattern = CullPattern(List=vector_2pt_2.Length, CullPattern=null_item.NullFlags)
replace_items = ReplaceItems(List=vector_2pt_2.Length, Item=Slider(0, range=0..100), Indices=cull_pattern, Wrap=False)  # -> flatten(List)

# ----
entwine = Entwine(Branch00=pointcurve, Branch01=vtangente, Branch02=division, Branch03=replace_items, FlattenInputs=True)  # -> flatten(Result)

# ---- group: sacamos distancias y escribimos dataset (continued)
c_script_3 = CSharpScript(Path=concatenate_2, DataSet=entwine, Run=Toggle(False))  # -> out, A; inputs Path: String, DataSet: tree, Run: Boolean; same code as c_script

# ----
graft_tree = GraftTree(Tree=entwine, IncludeEmptyLists=True, IncludeNullItems=True)  # -> simplify(Tree)
panel_2 = Panel(graft_tree)
